# Requirement set 0 best_requirements (R2017b)

## 1 [#7] MEP Measurement

## 2 [#8] Motor Hotspot Search
Priority: Low

## 3 [#9] Motor Threshold Hunting
Priority: Essential

## 4 [#10] MEP IOC
Priority: Medium

## 5 [#11] EEGTMS
Priority: High

## 6 [#12] rTMS Intervention

## 7 [#13] Multimodal Experiment

## 8 [#14] TEP Hotspot Search

## 9 [#15] TEP Measurement

## 10 [#16] TEP IOC

## 11 [#20] Multimodal Experiment

### 11.1 [#22] Interactive application
Priority: Essential

#### 11.1.1 [#23] Iconing of library
List of icons:
stimulator (any device icon would work here)
condition (any panel with tabs would here )
sp (sq wave)
pp (cs+ts)
pp (ts+scs)
train (three sq waves)
Icons for later on:
Audio Masking
Audio Stimulus + Video stimulus would go as part in the hardware configuration panel
Priority: Essential

#### 11.1.2 [#29] interacting with axes to add pulses on any stimulator
add ui menu to each of the pulses
uimenu will check how many stimulators are available in that condition
uimenu will show those stimulator 1 ..... stimulator N on the menu to select for
user will select any one
the pulse would go there
Later on:
drag and drop interaction can be placed but thats so much time consuiming therefore not in the list even yet
Priority: Essential

#### 11.1.3 [#30] deleting a particularly added pulse
Priority: Essential

#### 11.1.4 [#31] deleting a particular added stimulator
Priority: Essential

#### 11.1.5 [#32] changing the Target chanel using the Global Channel Selector
The global channel selector pannel would save the data in a cell str format to the targetChannel string
Priority: Low

#### 11.1.6 [#33] callback based saving of the inputs data
Priority: Essential

#### 11.1.7 [#34] callback based reloading of the axes when measures are changed from listbox
Priority: Essential

### 11.2 [#24] MEP Measurement

### 11.3 [#25] IOC Measurement

### 11.4 [#26] Motor Thresholding

### 11.5 [#27] Psychometric Thresholding

### 11.6 [#28] EEGTMS

## 12 [#35] BEST GUI

### 12.1 [#37] Cleaning
No command should be visible at the command line except for those coming from external toolboxes e.g. fieldtrip magic or anything ekse
Priority: Essential

## 13 [#38] Hardware Configuration

### 13.1 [#39] Auditory stimulus device addition among output devices
Priority: Low

### 13.2 [#40] Visual stimulus device addition among output devices
Priority: Low