% Requirement links of BEST.m (R2017b)

% line 1434 links to 0 best_requirements.slreqx#29
            obj.pi.mm.stim.(cd).(st).plt=plot([-45 45],[-1*obj.pi.mm.stim.(cd).no -1*obj.pi.mm.stim.(cd).no],'Color','k','parent',obj.pi.mm.cond.(cd).ax,'LineWidth',2,'Tag',num2str(obj.pi.mm.stim.(cd).no),'ButtonDownFcn',@cb_stimulatorSelector); %line

% lines 1445-1472 links to 0 best_requirements.slreqx#33: callback based saving of the inputs data
            text(0,-1*obj.pi.mm.stim.(cd).no,'click to tag device','VerticalAlignment','bottom','Color',[0.50 0.50 0.50],'FontSize',9,'FontAngle','italic','Tag',num2str(obj.pi.mm.stim.(cd).no),'ButtonDownFcn',@obj.cb_pi_mm_output_device)
            
            function cb_stimulatorSelector(source,~)
                if(isvalid(obj.pi.mm.stimulatorSelector))
                    obj.pi.mm.stimulatorSelector.Color='k';
                end
                obj.pi.mm.stim.(cd).slctd=str2double(source.Tag);
                source.Color='b';
                obj.pi.mm.stimulatorSelector=source;
            end
        end
        function cb_pi_mm_pulse(obj,source,~)
            % 11-Mar-2020 18:13:21
            cd=['cd' num2str(obj.pi.mm.tab.SelectedChild)];
            
%             obj.pi.mm.stim.(cd).slctd=1 ;
            
            
            st=['st' num2str(obj.pi.mm.stim.(cd).slctd)];
            obj.pi.mm.stim.(cd).(st).pulse_count=obj.pi.mm.stim.(cd).(st).pulse_count+1;
            
            switch source.Tag
                case 'single_pulse'
                    obj.pi.mm.stim.(cd).(st).pulse_types{1,obj.pi.mm.stim.(cd).(st).pulse_count}=cellstr('single_pulse');
                    text(obj.pi.mm.stim.(cd).(st).pulse_count-0.25,-obj.pi.mm.stim.(cd).slctd+0.41,'       TS:[?] %MSO','VerticalAlignment','bottom','Color',[0.50 0.50 0.50],'FontSize',7,'FontAngle','italic','UserData',[obj.pi.mm.stim.(cd).(st).pulse_count,obj.pi.mm.stim.(cd).slctd],'ButtonDownFcn',@obj.cb_pi_mm_sp_inputfig) % 11-Mar-2020 14:49:00
                   
%                     p1 = [1.15 -1.1];                         % First Point
                    %                     p2 = [2 -1.1];                         % Second Point

% lines 1447-1454 links to 0 best_requirements.slreqx#29
            function cb_stimulatorSelector(source,~)
                if(isvalid(obj.pi.mm.stimulatorSelector))
                    obj.pi.mm.stimulatorSelector.Color='k';
                end
                obj.pi.mm.stim.(cd).slctd=str2double(source.Tag);
                source.Color='b';
                obj.pi.mm.stimulatorSelector=source;
            end

% line 1517 links to 0 best_requirements.slreqx#29
            obj.pi.mm.stim.(cd).(st).plt=plot(x,y,'Color','k','parent',obj.pi.mm.cond.(cd).ax,'LineWidth',2,'Tag',num2str(obj.pi.mm.stim.(cd).slctd),'ButtonDownFcn',@cb_stimulatorSelector); %line

% lines 1531-1539 links to 0 best_requirements.slreqx#29
            function cb_stimulatorSelector(source,~)
                if(isvalid(obj.pi.mm.stimulatorSelector))
                    
                    obj.pi.mm.stimulatorSelector.Color='k';
                end
                obj.pi.mm.stim.(cd).slctd=str2double(source.Tag);
                source.Color='b';
                obj.pi.mm.stimulatorSelector=source;
            end